# Grasshopper definition drawNautilus.gh (Grasshopper 1.0.7)

number_slider = Slider(1, range=0..5)
number_slider_2 = Slider(0.5, range=0..0.5)
number_slider_3 = Slider(80, range=0..100)
number_slider_4 = Slider(1.6, range=0..30)
number_slider_5 = Slider(0.3, range=0..1)
number_slider_6 = Slider(0.08, range=0..0.1)

vector_xyz = VectorXYZ(XComponent=0, YComponent=0, ZComponent=0)  # -> Vector, Length
# Design is a series of informational operations
panel = Panel("Predict Unprediction")
read_file = ReadFile(File="C:\Zac\19 Github\Notes\MASdfab-Week2\drawNautilus.py", PerLineParse=False)
ghpython_script = GhPythonScript()  # -> out, a
# ---------- ghpython_script: Python ----------
import Rhino.Geometry as rg
a rg.Interval(
# ---------- end ghpython_script ----------
ghpython_script_2 = GhPythonScript(count=Slider(10, range=0..10), force=vector_xyz.Vector, time=Slider(10, range=0..10))  # -> out, a; inputs count: Int32, force: Vector3d, time: Int32
# ---------- ghpython_script_2: Python ----------
import Rhino.Geometry as rg
import random
class Bouncy():
    def __init__(self, p, v, a):
        self.p = p
        self.v = v
        self.a = a
        self.pts = []
    def move(self):
        self.pts.append(self.p)
        self.v += self.a
        self.p += self.v
    def draw_path(self):
        return rg.Curve.CreateInterpolatedCurve(self.pts, 1)
random.seed(0)
bouncies = []
for _ in range(count):
    bouncy = Bouncy(rg.Point3d(0, 0, 0), rg.Vector3d(random.uniform(-1, 1),
    random.uniform(-1, 1), random.uniform(-1, 1)), force)
    bouncies.append(bouncy)
for _ in range(time):
    for bouncy in bouncies:
        bouncy.move()
trajectories = []
for bouncy in bouncies:
    trajectories.append(bouncy.draw_path())
# ---------- end ghpython_script_2 ----------
ghpython_script_3 = GhPythonScript(
    Code=read_file,
    NautilusSize=1,
    PiceSize=0.5,
    PiceNumber=80,
    Sharpness=0.08,
    CircleSize=1.6,
    CircleRotation=0.3,
    IsSketch=Toggle(True),
    InTemp="12")  # -> Out, Circles, Objects, Colours, SketchLines1, SketchLines2, SketchLines3, SketchLines4, SketchLines5, OutTemp
panel_2 = Panel(ghpython_script_3.Out)
panel_3 = Panel(ghpython_script_3.SketchLines1)
curve_display = CurveDisplay(Curve=ghpython_script_3.SketchLines1, Width=Slider(0.5, range=0..1), Colour=ColourSwatch(SwatchColor=RGB(76, 76, 76)))  # inputs Curve: Curve, Width: Int32, Colour: Color, Dash: String
# ---------- curve_display: C# ----------
    if (Curve == null) return;
    if (Width <= 0) return;

    double[] pattern = ParseDashPattern(Dash);
    IEnumerable<Curve> segments = ApplyDashPattern(Curve, pattern);

    _clip = BoundingBox.Union(_clip, Curve.GetBoundingBox(false));
    foreach (Curve segment in segments)
    {
      _curves.Add(segment);
      _colors.Add(Colour);
      _widths.Add(Width);
    }
# ---------- curve_display: C# additional code ----------
  /// <summary>
  /// Parse a dash pattern.
  /// </summary>
  /// <param name="pattern">Pattern to parse.</param>
  /// <returns>Array of dashes and gaps.</returns>
  private double[] ParseDashPattern(string pattern)
  {
    if (string.IsNullOrWhiteSpace(pattern))
      return null;

    string[] fragments = pattern.Split(new char[] {' '});
    if (fragments == null || fragments.Length == 0)
      return null;

    double[] values = new double[fragments.Length];
    for (int i = 0; i < fragments.Length; i++)
    {
      double v;
      if (!double.TryParse(fragments[i], out v))
        throw new Exception(fragments[i] + " is a not a valid number.");

      if (v <= 0.0)
        throw new Exception("Dashes or gaps must have a strictly positive length.");

      values[i] = v;
    }

    return values;
  }
  /// <summary>
  /// Apply a dash+gap pattern to a curve.
  /// </summary>
  private IEnumerable<Curve> ApplyDashPattern(Curve curve, double[] pattern)
  {
    if (pattern == null || pattern.Length == 0)
      return new Curve[] { curve };

    double curveLength = curve.GetLength();
    List<Curve> dashes = new List<Curve>();

    double offset0 = 0.0;
    int index = 0;
    while(true)
    {
      // Get the current dash length.
      double dashLength = pattern[index++];
      if (index >= pattern.Length)
        index = 0;

      // Compute the offset of the current dash from the curve start.
      double offset1 = offset0 + dashLength;
      if (offset1 > curveLength)
        offset1 = curveLength;

      // Solve the curve parameters at the current dash start and end.
      double t0, t1;
      curve.LengthParameter(offset0, out t0);
      curve.LengthParameter(offset1, out t1);

      Curve dash = curve.Trim(t0, t1);
      if (dash != null)
        dashes.Add(dash);

      // Get the current gap length.
      double gapLength = pattern[index++];
      if (index >= pattern.Length)
        index = 0;

      // Set the start of the next dash to be the end of the current
      // dash + the length of the adjacent gap.
      offset0 = offset1 + gapLength;

      // Abort when we've reached the end of the curve.
      if (offset0 >= curveLength)
        break;
    }

    return dashes;
  }

  private BoundingBox _clip;
  private readonly List<Curve> _curves = new List<Curve>();
  private readonly List<Color> _colors = new List<Color>();
  private readonly List<int> _widths = new List<int>();

  /// <summary>
  /// This method will be called once every solution, before any calls to RunScript.
  /// </summary>
  public override void BeforeRunScript()
  {
    _clip = BoundingBox.Empty;
    _curves.Clear();
    _colors.Clear();
    _widths.Clear();
  }

  /// <summary>
  /// Return a BoundingBox that contains all the geometry you are about to draw.
  /// </summary>
  public override BoundingBox ClippingBox
  {
    get { return _clip; }
  }
  /// <summary>
  /// Draw all wires and points in this method.
  /// </summary>
  public override void DrawViewportWires(IGH_PreviewArgs args)
  {
    for (int i = 0; i < _curves.Count; i++)
      args.Display.DrawCurve(_curves[i], _colors[i], _widths[i]);
  }
# ---------- end curve_display ----------
curve_display_2 = CurveDisplay(Curve=ghpython_script_3.SketchLines2, Width=Slider(0.5, range=0..1), Colour=ColourSwatch(SwatchColor=RGB(207, 207, 207)))  # inputs Curve: Curve, Width: Int32, Colour: Color, Dash: String; same code as curve_display
curve_display_3 = CurveDisplay(Curve=ghpython_script_3.SketchLines3, Width=Slider(0.5, range=0..1), Colour=ColourSwatch(SwatchColor=RGB(168, 168, 168)))  # inputs Curve: Curve, Width: Int32, Colour: Color, Dash: String; same code as curve_display
geometry = Geometry(ghpython_script_3.Objects)
