# Grasshopper definition Mandelbrot.gh (Grasshopper 1.0.7)

read_file = ReadFile(File="C:\Zac\19 Github\Notes\MASdfab-Week3-4\Mandelbrot.py", PerLineParse=False)
c_script = CSharpScript()  # -> out, A
# ---------- c_script: C# ----------
    print(sin(-18.849556));
# ---------- end c_script ----------
ghpython_script = GhPythonScript(Code=read_file)  # -> Out, OutTemp
geometry = Geometry([Point(-100, 0, -12.5), Point(-87.5, -50, 25), Point(-87.5, -37.5, 12.5), Point(-87.5, -37.5, 25), Point(-87.5, -12.5, -25), Point(-87.5, 0, -25)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])
list_item = ListItem(List=geometry, Index=Slider(0, range=0..100), Wrap=True)
geometry_2 = Geometry(ghpython_script.OutTemp)
panel = Panel(ghpython_script.Out)
panel_2 = Panel("-4.7699523E-8")
text = Text(["0x0x0", "0x0x1", "0x0x2", "0x0x3", "0x0x4", "0x0x5"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])
