# Grasshopper definition Axolotl.gh (Grasshopper 1.0.7)
# plug-ins: Axolotl Info

tpms = TPMS(Wavelength=Slider(10, range=0..10), type=11)
tpms_2 = TPMS(Wavelength=Slider(3, range=0..10), type=1)
plane = Plane(Origin=Point(0, 0, 0), Normal=Vector(0, 0, 1))
box = Box(DimensionX=8, DimensionY=7, DimensionZ=6, Radius=0, Plane=PlaneXY(0, 0, 0))
blend = Blend(DistanceObject=tpms, DistanceObject_2=tpms_2, DistanceObject_3=plane, Range=3, type=0)
boolean_intersect = BooleanIntersect(DistanceObjectS=box, DistanceObject=blend)
isosurface_distancefunction = IsosurfaceDistancefunction(NumberX=50, NumberY=50, NumberZ=50, Isovalue=0, Capped=False, DistanceObject=boolean_intersect, Refine=True)
custom_preview = CustomPreview(
    Geometry=isosurface_distancefunction,
    Material={diffuse=RGB(221, 160, 221), emission=RGB(66, 48, 66), shine=0.5, specular=RGB(255, 255, 255), transparency=0})
