# Grasshopper definition Mandelbrot_v2.gh (Grasshopper 1.0.7)

# ---- group: DIM=32
data = Data(["{-100.0,-6.25,-18.75}", "{-100.0,0.0,-18.75}", "{-100.0,6.25,-18.75}", "{-93.75,-43.75,18.75}", "{-93.75,-37.5,25.0}", "{-93.75,-6.25,-18.75}"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])

# ---- group: DIM=64
data_2 = Data(["{-100.0,-12.5,-15.625}", "{-100.0,-9.375,-18.75}", "{-100.0,-6.25,-21.875}", "{-100.0,-3.125,-21.875}", "{-100.0,0.0,-21.875}", "{-100.0,3.125,-21.875}"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])

# ---- group: DIM=128
data_3 = Data(["{-100.0,-12.5,-15.625}", "{-100.0,-9.375,-18.75}", "{-100.0,-7.8125,-18.75}", "{-100.0,-6.25,-21.875}", "{-100.0,-4.6875,-21.875}", "{-100.0,-4.6875,-7.8125}"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])

# ----
point = Point(data)
list_item = ListItem(List=point, Index=Slider(1000, range=0..1000), Wrap=True)
