# Grasshopper definition Mandelbrot_v3.gh (Grasshopper 1.0.7)
# plug-ins: Palette, MetaHopper

read_file = ReadFile(File="C:\Zac\19 Github\Notes\MASdfab-Week5\MarchingCubes.py", PerLineParse=False)
number_slider = Slider(10, range=0..10)
number_slider_2 = Slider(10, range=0..10)
ghpython_script = GhPythonScript(Code=read_file)  # -> Out, OutTemp
number_slider_3 = Slider(100, range=0..100)
triangulate = Triangulate(Mesh=ghpython_script.OutTemp)  # -> Mesh, Count
unit_z = UnitZ(Factor="-10")
mesh_edges = MeshEdges(Mesh=triangulate.Mesh)  # -> NakedEdges, InteriorEdges, NonManifoldEdges
number_slider_4 = Slider(5, range=0..10)
series = Series(Start=0, Step="0.1", Count="11")
number_slider_5 = Slider(5, range=0..10)
move = Move(Geometry=ghpython_script.OutTemp, Motion=unit_z)  # -> Geometry, Transform
geometry = Geometry(<mesh referenced from the Rhino model>)
gradient = Gradient(
    LowerLimit=0,
    UpperLimit=1,
    Parameter=series,
    stops=[0: RGB(234, 38, 0), 0.25: RGB(234, 126, 0), 0.5: RGB(254, 244, 84), 0.75: RGB(173, 203, 249), 1: RGB(75, 107, 169)])
gradient_2 = Gradient(
    LowerLimit=0,
    UpperLimit=1,
    Parameter=series,
    stops=[0: RGBA(0, 0, 0, 0), 0.25: RGB(129, 143, 70), 0.5: RGB(128, 85, 58), 0.75: RGB(173, 203, 249), 1: RGB(176, 181, 197)])
gradient_3 = Gradient(LowerLimit=0, UpperLimit=1, Parameter=series, stops=[0: RGB(255, 255, 255), 1: RGB(0, 0, 0)])
gradient_4 = Gradient(
    LowerLimit=0,
    UpperLimit=1,
    Parameter=series,
    stops=[0: RGB(0, 98, 0), 0.25: RGB(81, 175, 17), 0.5: RGB(159, 198, 146), 0.75: RGB(170, 235, 41), 1: RGB(221, 255, 53)])
read_file_2 = ReadFile(File="C:\Zac\19 Github\Notes\MASdfab-Week5\Mandelbrot_v3.py", PerLineParse=False)
geometry_2 = Geometry(<mesh referenced from the Rhino model>)
ghpython_script_2 = GhPythonScript(
    Code=read_file_2,
    InTemp=geometry_2,
    XRoughness=number_slider_3,
    YRoughness=number_slider_3,
    ZRoughness=number_slider_3,
    Colors=reverse(gradient_4))  # -> Out, OutTemp, X
number = Number(ghpython_script_2.OutTemp)
mesh = Mesh(ghpython_script_2.OutTemp)
panel = Panel(ghpython_script_2.OutTemp)
panel_2 = Panel(ghpython_script_2.Out)
colour_swatch = ColourSwatch(SwatchColor=RGB(255, 255, 255))
palette = Palette(
    ModeCustomStandard=Toggle(True),
    Component_Normal_Deselected_Fill_Color=RGB(200, 200, 200),
    Component_Normal_Deselected_Edge_Color=RGB(50, 50, 50),
    Component_Normal_Deselected_Text_Color=RGB(0, 0, 0),
    Component_Normal_Selected_Fill_Color=RGB(130, 215, 50),
    Component_Normal_Selected_Edge_Color=RGB(0, 50, 0),
    Component_Normal_Selected_Text_Color=RGB(0, 25, 0),
    Component_Hidden_Deselected_Fill_Color=RGB(140, 140, 155),
    Component_Hidden_Deselected_Edge_Color=RGB(35, 35, 35),
    Component_Hidden_Deselected_Text_Color=RGB(0, 0, 0),
    Component_Hidden_Selected_Fill_Color=RGB(80, 180, 10),
    Component_Hidden_Selected_Edge_Color=RGB(0, 35, 0),
    Component_Hidden_Selected_Text_Color=RGB(0, 25, 0),
    Component_Disabled_Deselected_Fill_Color=RGB(120, 120, 120),
    Component_Disabled_Deselected_Edge_Color=RGB(90, 90, 90),
    Component_Disabled_Deselected_Text_Color=RGB(70, 70, 70),
    Component_Disabled_Selected_Fill_Color=RGB(110, 150, 115),
    Component_Disabled_Selected_Edge_Color=RGB(40, 70, 40),
    Component_Disabled_Selected_Text_Color=RGB(75, 100, 65),
    Component_Warning_Deselected_Fill_Color=RGB(255, 140, 20),
    Component_Warning_Deselected_Edge_Color=RGB(80, 10, 0),
    Component_Warning_Deselected_Text_Color=RGB(0, 0, 0),
    Component_Warning_Selected_Fill_Color=RGB(185, 205, 0),
    Component_Warning_Selected_Edge_Color=RGB(0, 50, 0),
    Component_Warning_Selected_Text_Color=RGB(0, 0, 0),
    Component_Error_Deselected_Fill_Color=RGB(200, 0, 0),
    Component_Error_Deselected_Edge_Color=RGB(60, 0, 0),
    Component_Error_Deselected_Text_Color=RGB(0, 0, 0),
    Component_Error_Selected_Fill_Color=RGB(125, 155, 0),
    Component_Error_Selected_Edge_Color=RGB(0, 50, 0),
    Component_Error_Selected_Text_Color=RGB(255, 255, 255),
    Component_Label_Deselected_Fill_Color=RGB(50, 50, 50),
    Component_Label_Deselected_Edge_Color=RGB(0, 0, 0),
    Component_Label_Deselected_Text_Color=RGB(255, 255, 255),
    Component_Label_Selected_Fill_Color=RGB(25, 60, 25),
    Component_Label_Selected_Edge_Color=RGB(0, 35, 0),
    Component_Label_Selected_Text_Color=RGB(190, 250, 180),
    Galapagos_Deselected_Fill_Color=RGB(255, 0, 125),
    Galapagos_Deselected_Edge_Color=RGB(100, 0, 50),
    Galapagos_Selected_Fill_Color=RGB(160, 210, 30),
    Galapagos_Selected_Edge_Color=RGB(0, 50, 0),
    Wire_Normal_Color=colour_swatch,
    Wire_Empty_Color=RGBA(255, 60, 0, 180),
    Wire_Selected_Start_Color=RGB(125, 210, 40),
    Wire_Selected_End_Color=colour_swatch,
    Panel_Default_Color=ColourSwatch(SwatchColor=RGBA(255, 255, 255, 200)),
    Group_Default_Color=ColourSwatch(SwatchColor=RGBA(255, 255, 255, 80)),
    Canvas_Background_Color=RGB(212, 208, 200),
    Canvas_Gridline_Color=RGBA(0, 0, 0, 30),
    Canvas_Gridline_Width=150,
    Canvas_Gridline_Height=50,
    Canvas_Edge_Color=RGB(0, 0, 0),
    Canvas_Shadow_Color=RGBA(0, 0, 0, 80),
    Canvas_Shadow_Size=30,
    MonochromaticOnOff=Toggle(True),
    Monochromatic_Color=ColourSwatch(SwatchColor=RGB(0, 0, 0)))
capture_gh_canvas = CaptureGHCanvas(
    Capture=Button(),
    ScaleFactor=1,
    SaveLocation="C:\Users\Zac\Desktop\GH_Capture.png",
    BackgroundColor=ColourSwatch(SwatchColor=RGB(0, 0, 0)))
